# Requirement set RequirmentTable (R2024a)

## 1 [1] Review Order
The platform shall allow users to review current order with price of each product / product quantity / total price before the order.
Requirement Type: Functional

## 2 [2] Modify Order
The platform shall allow users to add / remove products from order before payment
Requirement Type: Functional

## 3 [3] Tracking Order
The Platform shall track the order though GPS system.
Requirement Type: Functional

## 4 [4] Compatibility Mobile
The platform shall be compatible with mobile device (Android & IOS).
Requirement Type: Functional

## 5 [5] Compatibility Desktop
The platform shall be compatible with PC (Windows and MacOS).
Requirement Type: Functional

## 6 [6] Search Bar
The platform shall have search bar for user to search stores / products.
Requirement Type: Functional

## 7 [7] Customer Support
The platform shall have customer support include Live Chat, FAQ sections and Order Help include Cancel Order and Refund.
Requirement Type: Functional

## 8 [8] Subscribe Notification
The platform shall allow users to subscribe stores discount notifications through email.
Requirement Type: Functional

## 9 [9] Modify Menu Products
The Platform shall allow merchants to add / remove products from menus.
Requirement Type: Functional

## 10 [10] Modify Product Price
The Platform shall allow merchants to set / change price for each product from menus.
Requirement Type: Functional

## 11 [11] Modify Product Description
The Platform shall allow merchants to add / edit products description include food ingredient list & total numbers of the product.
Requirement Type: Functional

## 12 [12] Modify Product Image
The Platform shall allow merchants to add / edit front & back photographs of products.
Requirement Type: Functional

## 13 [13] Availability
The platform shall be available 22 ± 2 hours a day in the USA by 2025.
Requirement Type: Functional

## 14 [14] Account Creation
The platform shall allow users to create maximum of 2 accounts by using the same phone number / email address.
Requirement Type: Functional

## 15 [15] Account Update
The platform shall allow users to update account information include Phone Number, Home Address, Nickname, Payment Methods.
Requirement Type: Functional

## 16 [16] Account Management
The platform shall allow users to management account include Membership, Platform Setting, Notification, Favourite Store.
Requirement Type: Functional

## 17 [17] Login Authentication
The platform shall have secure login authentication mechanism by sending code through text messages / email to verify authentication.
Requirement Type: Performance

## 18 [18] Transaction Time
The platform shall process the transaction time in 10s ± 5s from the time the order was placed.
Requirement Type: Performance

## 19 [19] Up / Down Time
The platform shall have uptime 166 hours, 98% time of a week. Downtime shall have 2 hours, 2% time of a week at night on PST.
Requirement Type: Design

## 20 [20] Product Element
The interface shall include the product elements include food ingredient list & total numbers of the product as product description.
Requirement Type: Design

## 21 [21] Product Image
The interface shall include with front & back photographs of products.
Requirement Type: Design

## 22 [22] Menu Stores
The platform shall have at least 1 menu from the cooperative stores.
Requirement Type: Design

## 23 [23] Cart Limit
The platform shall allow users to add maximum of 9999 product numbers into cart.
Requirement Type: Design

## 24 [24] Product Recommendation
A dynamic product recommendation system shall be deployed by the platform to recommend new offerings from merchants to customers in a timeframe of every 168 hours.
Requirement Type: Design

## 25 [25] Discount
The platform shall include discounts for customer orders to customers through a membership system.
Requirement Type: Design

## 26 [26] Order Management Limit
The platform shall allow users to add / remove products within 10 minutes of placing the order.
Requirement Type: Design

## 27 [27] Feedback
The platform shall allow customer to leave comments and 1 to 5 stars feedback for products from cooperate stores.
Requirement Type: Design

## 28 [28] Online Payment Methods
The platform shall support multiple payment methods: Credit Card, Debit Card, PayPal, Venmo, Alipay, WeChat Pay, Apple Pay.
Requirement Type: Design

## 29 [29] Gift Card Payment
The Platform shall support platform gift card as payment method.
Requirement Type: Design

## 30 [30] Incentive Plan (Informational)
The platform shall have the incentive plan for delivery personnel to increase express revenue.
Requirement Type: Non-Functional

## 31 [31] Partnership (Informational)
The platform shall establish partnerships with 10,000 ± 1000 merchants in California by 2025.
Requirement Type: Non-Functional